# Dynamo graph SHARED_PARAM.dyn (Dynamo 2.0.4.12684)

# group: PYTHON<DESCRPTION>
# note: PYTHON <DESCRIPTION>

# group: SET<DESCRPTION>
# note: SET <DESCRIPTION>

# group: DESIGN<DESCRPTION>
# note: DESIGN <DESCRIPTION>

# group: IMPORT
# note: IMPORT FILES

# group: INPUTS
# note: INPUTS

# group: INPUTS
output_xls_file = Filename("..\SHARED_PARAM_NEW.xlsx")  # graph input
# note: AUTHOR:
# ©PAWEŁ DREIER
input_xls_file = Filename("..\SHARED_PARAM.xlsx")  # graph input
error_log_file = Filename("..\ERROR_LOG.txt")  # graph input

# group: READ XLS
file_from_path = FileObject(path=input_xls_file)
python_script = Python(IN[0]=file_from_path)
# ---------- python_script.python (40 lines) ----------
#python nodes in dynamo 1.0
#proposed by Julien Benoit @jbenoit44
#http://aecuandme.wordpress.com/

#Credits for Traceback:
# Copyright(c) 2015, Konrad K Sobon
# @arch_laboratory, http://archi-lab.net

import clr
clr.AddReference('ProtoGeometry')
from Autodesk.DesignScript.Geometry import *
# Import ToDSType(bool) extension method
clr.AddReference("RevitNodes")
import Revit
clr.ImportExtensions(Revit.Elements)
# Import geometry conversion extension methods
clr.ImportExtensions(Revit.GeometryConversion)
# Import DocumentManager and TransactionManager
clr.AddReference("RevitServices")
import RevitServices
from RevitServices.Persistence import DocumentManager
from RevitServices.Transactions import TransactionManager
from System.Collections.Generic import *
# Import RevitAPI
clr.AddReference("RevitAPI")
import Autodesk
from Autodesk.Revit.DB import *

import sys
pyt_path = r'C:\Program Files (x86)\IronPython 2.7\Lib'
sys.path.append(pyt_path)

# The inputs to this node will be stored as a list in the IN variables.
string = str(IN[0])
string = string.split('\\')[-1].split(".xls")[0]

# Place your code below this line

# Assign your output to the OUT variable.
OUT = string
# ----------------------------------------
code_block = CodeBlock { true; false; }
importExcel = Data.ImportExcel(file=file_from_path, sheetName=python_script, readAsStrings=code_block.out0, showExcel=code_block.out1)
deconstruct = List.Deconstruct(list=importExcel)
file_from_path_2 = FileObject(path=error_log_file)

# group: PYTHON
python_script_2 = Python(IN[0]=deconstruct.first, IN[1]=deconstruct.rest)
# ---------- python_script_2.python (1172 lines) ----------
# P.DREIER ©  github.com/dreierpawel
import math
import clr
import sys

sys.path.append('C:\Program Files (x86)\IronPython 2.7\Lib')
import System
from System import Array
from System.Collections.Generic import *

clr.AddReference('ProtoGeometry')
from Autodesk.DesignScript.Geometry import *

clr.AddReference("RevitNodes")
import Revit

clr.ImportExtensions(Revit.Elements)
clr.ImportExtensions(Revit.GeometryConversion)
clr.AddReference("RevitServices")
import RevitServices
from RevitServices.Persistence import DocumentManager
from RevitServices.Transactions import TransactionManager

clr.AddReference("RevitAPI")
clr.AddReference("RevitAPIUI")

import Autodesk
from Autodesk.Revit.DB import *
from Autodesk.Revit.UI import *

import clr

clr.AddReference('RevitAPI')
clr.AddReference('RevitAPIUI')
import Autodesk.Revit.DB as DB
import Autodesk.Revit.UI as UI
import System
import System.IO
# import System.Windows.Forms as Forms
import System.Collections.Generic as Collections

doc = DocumentManager.Instance.CurrentDBDocument
uiapp = DocumentManager.Instance.CurrentUIApplication
app = uiapp.Application
uidoc = uiapp.ActiveUIDocument
from_xls_parameters_dataset_lst = IN[1]


def flatten_list(nested_list):
    """
    Flatten a list of lists into a single list.
    """
    flattened_list = []
    for item in nested_list:
        if isinstance(item, list):
            flattened_list.extend(flatten_list(item))
        else:
            flattened_list.append(item)
    return flattened_list


def dict_of_all_categories_from_xls(xls_definition_values_lst):
    binding_type_from_xls_from_xls = xls_definition_values_lst[8]  # 0 - TYPE / 1 - INSTANCE -> str
    categories_set_names_from_xls = xls_definition_values_lst[10]  # CATEGORIES LIST -> str
    if categories_set_names_from_xls == "All" and binding_type_from_xls_from_xls == "0":
        # All categories for Type
        categories_set_names_from_xls = "Analytical Links, Structural Rebar Couplers, Structural Connections, " \
                                        "Structural Fabric Areas, Structural Fabric Reinforcement, Rebar Shape, " \
                                        "Structural Path Reinforcement, Structural Area Reinforcement, " \
                                        "Structural Rebar, MEP Fabrication Containment, MEP Fabrication Pipework, " \
                                        "MEP Fabrication Hangers, MEP Fabrication Ductwork, Pipe Placeholders, " \
                                        "Duct Placeholders, Cable Tray Runs, Conduit Runs, Conduits, Cable Trays, " \
                                        "Conduit Fittings, Cable Tray Fittings, Duct Linings, Duct Insulations, " \
                                        "Pipe Insulations, Sprinklers, Lighting Devices, Fire Alarm Devices, " \
                                        "Data Devices, Communication Devices, Security Devices, Nurse Call Devices, " \
                                        "Telephone Devices, Pipe Accessories, Flex Pipes, Pipe Fittings, Pipes, " \
                                        "Piping Systems, Wires, Flex Ducts, Duct Accessories, Duct Systems, " \
                                        "Air Terminals, Duct Fittings, Ducts, Mass, Detail Items, Entourage, " \
                                        "Planting, Structural Stiffeners, RVT Links, Specialty Equipment, " \
                                        "Topography, Structural Trusses, Structural Columns, " \
                                        "Structural Beam Systems, Structural Framing, Structural Foundations," \
                                        " Site, Parking, Plumbing Fixtures, Mechanical Equipment, " \
                                        "Lighting Fixtures, Furniture Systems, Electrical Fixtures, " \
                                        "Electrical Equipment, Casework, Mechanical Equipment Sets, " \
                                        "Analytical Pipe Connections, Curtain Systems, Assemblies, Levels, " \
                                        "Grids, Ramps, Curtain Wall Mullions, Curtain Panels, Generic Models, " \
                                        "Railings, Stairs, Columns, Model Groups, Furniture, Ceilings, " \
                                        "Roofs, Floors, Doors, Windows, Walls"
    if categories_set_names_from_xls == "All" and binding_type_from_xls_from_xls == "1":
        # All categories for Instance
        categories_set_names_from_xls = "Analytical Links, Analytical Nodes, Analytical Foundation Slabs, " \
                                          "Analytical Wall Foundations, Analytical Isolated Foundations, " \
                                          "Analytical Walls, Analytical Floors, Analytical Columns, " \
                                          "Analytical Braces, Analytical Beams, Structural Rebar Couplers, " \
                                          "Structural Connections, Structural Fabric Areas, " \
                                          "Structural Fabric Reinforcement, Rebar Shape, " \
                                          "Structural Path Reinforcement, Structural Area Reinforcement, " \
                                          "Structural Rebar, MEP Fabrication Containment, " \
                                          "MEP Fabrication Pipework, MEP Fabrication Hangers, " \
                                          "MEP Fabrication Ductwork, Analytical Surfaces, Analytical Spaces, " \
                                          "Pipe Placeholders, Duct Placeholders, Cable Tray Runs, Conduit Runs, " \
                                          "Conduits, Cable Trays, Conduit Fittings, Cable Tray Fittings, " \
                                          "Duct Linings, Duct Insulations, Pipe Insulations, HVAC Zones, " \
                                          "Switch System, Sprinklers, Lighting Devices, Fire Alarm Devices, " \
                                          "Data Devices, Communication Devices, Security Devices, " \
                                          "Nurse Call Devices, Telephone Devices, Pipe Accessories, " \
                                          "Flex Pipes, Pipe Fittings, Pipes, Piping Systems, Wires, " \
                                          "Electrical Circuits, Flex Ducts, Duct Accessories, Duct Systems, " \
                                          "Air Terminals, Duct Fittings, Ducts, Spaces, Mass, Areas, " \
                                          "Project Information, Sheets, Detail Items, Entourage, Planting, " \
                                          "Structural Stiffeners, RVT Links, Specialty Equipment, Topography, " \
                                          "Structural Trusses, Structural Columns, Structural Beam Systems, " \
                                          "Structural Framing, Structural Foundations, Site, Roads, Parking, " \
                                          "Plumbing Fixtures, Mechanical Equipment, Lighting Fixtures, " \
                                          "Furniture Systems, Electrical Fixtures, Electrical Equipment, " \
                                          "Casework, Shaft Openings, Mechanical Equipment Sets, " \
                                          "Analytical Pipe Connections, Materials, Schedules, " \
                                          "Curtain Systems, Views, Parts, Assemblies, Levels, Grids, Ramps, " \
                                          "Curtain Wall Mullions, Curtain Panels, Rooms, Generic Models, " \
                                          "Railings, Stairs, Columns, Model Groups, Furniture, Ceilings, " \
                                          "Roofs, Floors, Doors, Windows, Walls"
    return categories_set_names_from_xls


def dict_of_parameter_type():
    # more parameters_types on https://www.revitapidocs.com/2019/f38d847e-207f-b59a-3bd6-ebea80d5be63.html
    dict = {
        'Text': Autodesk.Revit.DB.ParameterType.Text,
        'String': Autodesk.Revit.DB.ParameterType.Text,
        'Integer': Autodesk.Revit.DB.ParameterType.Integer,
        'Number': Autodesk.Revit.DB.ParameterType.Number,
        'Length': Autodesk.Revit.DB.ParameterType.Length,
        'Area': Autodesk.Revit.DB.ParameterType.Area,
        'Volume': Autodesk.Revit.DB.ParameterType.Volume,
        'Angle': Autodesk.Revit.DB.ParameterType.Angle,
        'URL': Autodesk.Revit.DB.ParameterType.URL,
        'Material': Autodesk.Revit.DB.ParameterType.Material,
        'Multiline Text': Autodesk.Revit.DB.ParameterType.MultilineText,
        'YesNo': Autodesk.Revit.DB.ParameterType.YesNo
    }
    return dict


def dict_of_builtin_pg():
    pg_dict = {
        "Adaptive Component": BuiltInParameterGroup.PG_FLEXIBLE,
        "Advanced": BuiltInParameterGroup.PG_ENERGY_ANALYSIS_ADVANCED,
        #"Alternate Units": BuiltInParameterGroup.PG_ALTERNATE_UNITS,
        "Analysis Results": BuiltInParameterGroup.PG_ANALYSIS_RESULTS,
        "Analytical Alignment": BuiltInParameterGroup.PG_ANALYTICAL_ALIGNMENT,
        "Analytical Model": BuiltInParameterGroup.PG_ANALYTICAL_MODEL,
        "Analytical Properties": BuiltInParameterGroup.PG_ANALYTICAL_PROPERTIES,
        "Area": BuiltInParameterGroup.PG_AREA,
        "Bottom Chords": BuiltInParameterGroup.PG_TRUSS_FAMILY_BOTTOM_CHORD,
        "Building Data": BuiltInParameterGroup.PG_ENERGY_ANALYSIS_BUILDING_DATA,
        "Calculation Rules": BuiltInParameterGroup.PG_STAIRS_CALCULATOR_RULES,
        "Camera": BuiltInParameterGroup.PG_VIEW_CAMERA,
        "Conceptual Energy Data": BuiltInParameterGroup.PG_CONCEPTUAL_ENERGY_DATA,
        "Constraints": BuiltInParameterGroup.PG_CONSTRAINTS,
        "Construction": BuiltInParameterGroup.PG_CONSTRUCTION,
        # "Cross-Section Definition": BuiltInParameterGroup.PG_WALL_CROSS_SECTION_DEFINITION,
        "Data": BuiltInParameterGroup.PG_DATA,
        "Detailed Model": BuiltInParameterGroup.PG_ENERGY_ANALYSIS_DETAILED_MODEL,
        "Diagonal Webs": BuiltInParameterGroup.PG_TRUSS_FAMILY_DIAG_WEB,
        "Dimensions (linear units or % of thickness)": BuiltInParameterGroup.PG_SPLIT_PROFILE_DIMENSIONS,
        "Dimensions": BuiltInParameterGroup.PG_GEOMETRY,
        "Display": BuiltInParameterGroup.PG_DISPLAY,
        "Division Geometry": BuiltInParameterGroup.PG_DIVISION_GEOMETRY,
        "Electrical - Circuiting": BuiltInParameterGroup.PG_ELECTRICAL_CIRCUITING,
        "Electrical - Lighting": BuiltInParameterGroup.PG_ELECTRICAL_LIGHTING,
        "Electrical - Loads": BuiltInParameterGroup.PG_ELECTRICAL_LOADS,
        # "Electrical Analysis": BuiltInParameterGroup.PG_ELECTRICAL_ANALYSIS,
        # "Electrical Engineering": BuiltInParameterGroup.PG_ELECTRICAL_ENGINEERING,
        "Electrical": BuiltInParameterGroup.PG_ELECTRICAL,
        "End Connection": BuiltInParameterGroup.PG_STAIRS_OPEN_END_CONNECTION,
        "Energy Analysis": BuiltInParameterGroup.PG_ENERGY_ANALYSIS,
        "Energy Analytical Model": BuiltInParameterGroup.PG_ENERGY_ANALYSIS_CONCEPTUAL_MODEL,
        "Energy Model - Building Services": BuiltInParameterGroup.PG_CONCEPTUAL_ENERGY_DATA_BUILDING_SERVICES,
        "Essential": BuiltInParameterGroup.PG_ENERGY_ANALYSIS_DETAILED_AND_CONCEPTUAL_MODELS,
        "Extension (Beginning/Bottom)": BuiltInParameterGroup.PG_CONTINUOUSRAIL_BEGIN_BOTTOM_EXTENSION,
        "Extension (End/Top)": BuiltInParameterGroup.PG_CONTINUOUSRAIL_END_TOP_EXTENSION,
        "Extents": BuiltInParameterGroup.PG_VIEW_EXTENTS,
        "Fabrication Product Data": BuiltInParameterGroup.PG_FABRICATION_PRODUCT_DATA,
        "Fire Protection": BuiltInParameterGroup.PG_FIRE_PROTECTION,
        "Fittings": BuiltInParameterGroup.PG_FITTING,
        "Forces": BuiltInParameterGroup.PG_FORCES,
        "General": BuiltInParameterGroup.PG_GENERAL,
        "Geolocation": BuiltInParameterGroup.PG_GEO_LOCATION,
        "Geometric Position": BuiltInParameterGroup.PG_GEOMETRY_POSITIONING,
        "Graphics": BuiltInParameterGroup.PG_GRAPHICS,
        "Green Building Properties": BuiltInParameterGroup.PG_GREEN_BUILDING,
        "Grid 1 Mullions": BuiltInParameterGroup.PG_CURTAIN_MULLION_1,
        "Grid 1": BuiltInParameterGroup.PG_CURTAIN_GRID_1,
        "Grid 2 Mullions": BuiltInParameterGroup.PG_CURTAIN_MULLION_2,
        "Grid 2": BuiltInParameterGroup.PG_CURTAIN_GRID_2,
        "Grid": BuiltInParameterGroup.PG_CURTAIN_GRID,
        "Handrail 1": BuiltInParameterGroup.PG_RAILING_SYSTEM_FAMILY_HANDRAILS,
        "Handrail 2": BuiltInParameterGroup.PG_RAILING_SYSTEM_SECONDARY_FAMILY_HANDRAILS,
        "Horizontal Grid": BuiltInParameterGroup.PG_CURTAIN_GRID_HORIZ,
        "Horizontal Mullions": BuiltInParameterGroup.PG_CURTAIN_MULLION_HORIZ,
        "Identity Data": BuiltInParameterGroup.PG_IDENTITY_DATA,
        "IFC Parameters": BuiltInParameterGroup.PG_IFC,
        "Insulation": BuiltInParameterGroup.PG_INSULATION,
        "Layers": BuiltInParameterGroup.PG_REBAR_SYSTEM_LAYERS,
        "Length": BuiltInParameterGroup.PG_LENGTH,
        # "Life Safety": BuiltInParameterGroup.PG_LIFE_SAFETY,
        "Lining": BuiltInParameterGroup.PG_LINING,
        "Material Thermal Properties": BuiltInParameterGroup.PG_ENERGY_ANALYSIS_BLDG_CONS_MTL_THERMAL_PROPS,
        "Materials and Finishes": BuiltInParameterGroup.PG_MATERIALS,
        "Mechanical - Flow": BuiltInParameterGroup.PG_MECHANICAL_AIRFLOW,
        "Mechanical - Loads": BuiltInParameterGroup.PG_MECHANICAL_LOADS,
        "Mechanical": BuiltInParameterGroup.PG_MECHANICAL,
        "Model Properties": BuiltInParameterGroup.PG_ADSK_MODEL_PROPERTIES,
        "Moments": BuiltInParameterGroup.PG_MOMENTS,
        "Nodes": BuiltInParameterGroup.PG_NODES,
        "Overall Legend": BuiltInParameterGroup.PG_OVERALL_LEGEND,
        "Pattern Application": BuiltInParameterGroup.PG_PATTERN_APPLICATION,
        "Pattern Remainder": BuiltInParameterGroup.PG_RAILING_SYSTEM_SEGMENT_PATTERN_REMAINDER,
        "Pattern Repeat": BuiltInParameterGroup.PG_RAILING_SYSTEM_SEGMENT_PATTERN_REPEAT,
        "Pattern": BuiltInParameterGroup.PG_PATTERN,
        "Phasing": BuiltInParameterGroup.PG_PHASING,
        "Photometrics": BuiltInParameterGroup.PG_LIGHT_PHOTOMETRICS,
        "Plumbing": BuiltInParameterGroup.PG_PLUMBING,
        "Posts": BuiltInParameterGroup.PG_RAILING_SYSTEM_SEGMENT_POSTS,
        "Primary End": BuiltInParameterGroup.PG_PRIMARY_END,
        # "Primary Units": BuiltInParameterGroup.PG_PRIMARY_UNITS,
        "Profile 1": BuiltInParameterGroup.PG_PROFILE_1,
        "Profile 2": BuiltInParameterGroup.PG_PROFILE_2,
        "Profile": BuiltInParameterGroup.PG_PROFILE,
        "Rebar Set": BuiltInParameterGroup.PG_REBAR_ARRAY,
        "Reference": BuiltInParameterGroup.PG_REFERENCE,
        "Releases / Member Forces": BuiltInParameterGroup.PG_RELEASES_MEMBER_FORCES,
        "Rise / Drop": BuiltInParameterGroup.PG_SYSTEMTYPE_RISEDROP,
        "Risers": BuiltInParameterGroup.PG_STAIR_RISERS,
        "Room/Space Data": BuiltInParameterGroup.PG_ENERGY_ANALYSIS_ROOM_SPACE_DATA,
        "Rotation about": BuiltInParameterGroup.PG_ROTATION_ABOUT,
        # "Route Analysis": BuiltInParameterGroup.PG_ROUTE_ANALYSIS,
        "Secondary End": BuiltInParameterGroup.PG_SECONDARY_END,
        "Segment Pattern (default)": BuiltInParameterGroup.PG_RAILING_SYSTEM_FAMILY_SEGMENT_PATTERN,
        "Segments and Fittings": BuiltInParameterGroup.PG_SEGMENTS_FITTINGS,
        "Set": BuiltInParameterGroup.PG_COUPLER_ARRAY,
        "Slab Shape Edit": BuiltInParameterGroup.PG_SLAB_SHAPE_EDIT,
        "Stringers": BuiltInParameterGroup.PG_STAIR_STRINGERS,
        "Structural Analysis": BuiltInParameterGroup.PG_STRUCTURAL_ANALYSIS,
        "Structural Section Geometry": BuiltInParameterGroup.PG_STRUCTURAL_SECTION_GEOMETRY,
        "Structural": BuiltInParameterGroup.PG_STRUCTURAL,
        # "Terminations": BuiltInParameterGroup.PG_TERMINATION,
        "Text": BuiltInParameterGroup.PG_TEXT,
        "Threads/Risers": BuiltInParameterGroup.PG_STAIRS_TREADS_RISERS,
        "Title Text": BuiltInParameterGroup.PG_TITLE,
        "Top Chords": BuiltInParameterGroup.PG_TRUSS_FAMILY_TOP_CHORD,
        "Top Rail": BuiltInParameterGroup.PG_RAILING_SYSTEM_FAMILY_TOP_RAIL,
        "Translation in": BuiltInParameterGroup.PG_TRANSLATION_IN,
        "Treads": BuiltInParameterGroup.PG_STAIR_TREADS,
        "Underlay": BuiltInParameterGroup.PG_UNDERLAY,
        "Vertical Grid": BuiltInParameterGroup.PG_CURTAIN_GRID_VERT,
        "Vertical Mullions": BuiltInParameterGroup.PG_CURTAIN_MULLION_VERT,
        "Vertical Webs": BuiltInParameterGroup.PG_TRUSS_FAMILY_VERT_WEB,
        "Visibility": BuiltInParameterGroup.PG_VISIBILITY,
        "Winders": BuiltInParameterGroup.PG_STAIRS_WINDERS
    }
    return pg_dict


def dict_of_builtin_categories():
    # Get All Bound Parameters Category
    # https://forums.autodesk.com/t5/revit-api-forum/determine-if-category-supports-type-parameter-binding/td-p/4918068
    all_categories = doc.Settings.Categories
    all_type_categories = []
    for cat in all_categories:
        if cat.AllowsBoundParameters:
            all_type_categories.append(cat)
    cat_dict = {
        "All": all_type_categories,
        "Air Terminals": BuiltInCategory.OST_DuctTerminal,
        "Analytical Beams": BuiltInCategory.OST_BeamAnalytical,
        "Analytical Braces": BuiltInCategory.OST_BraceAnalytical,
        "Analytical Columns": BuiltInCategory.OST_ColumnAnalytical,
        "Analytical Floors": BuiltInCategory.OST_FloorAnalytical,
        "Analytical Foundation Slabs": BuiltInCategory.OST_FoundationSlabAnalytical,
        "Analytical Isolated Foundations": BuiltInCategory.OST_IsolatedFoundationAnalytical,
        "Analytical Links": BuiltInCategory.OST_LinksAnalytical,
        "Analytical Nodes": BuiltInCategory.OST_AnalyticalNodes,
        "Analytical Pipe Connections": BuiltInCategory.OST_AnalyticalPipeConnections,
        "Analytical Spaces": BuiltInCategory.OST_AnalyticSpaces,
        "Analytical Surfaces": BuiltInCategory.OST_GbXMLFaces,
        "Analytical Wall Foundations": BuiltInCategory.OST_WallFoundationAnalytical,
        "Analytical Walls": BuiltInCategory.OST_WallAnalytical,
        "Areas": BuiltInCategory.OST_Areas,
        "Assemblies": BuiltInCategory.OST_Assemblies,
        "Cable Tray Fittings": BuiltInCategory.OST_CableTrayFitting,
        "Cable Tray Runs": BuiltInCategory.OST_CableTrayRun,
        "Cable Trays": BuiltInCategory.OST_CableTray,
        "Casework": BuiltInCategory.OST_Casework,
        "Ceilings": BuiltInCategory.OST_Ceilings,
        "Columns": BuiltInCategory.OST_Columns,
        "Communication Devices": BuiltInCategory.OST_CommunicationDevices,
        "Conduit Fittings": BuiltInCategory.OST_ConduitFitting,
        "Conduit Runs": BuiltInCategory.OST_ConduitRun,
        "Conduits": BuiltInCategory.OST_Conduit,
        "Curtain Panels": BuiltInCategory.OST_CurtainWallPanels,
        "Curtain Systems": BuiltInCategory.OST_CurtaSystem,
        "Curtain Wall Mullions": BuiltInCategory.OST_CurtainWallMullions,
        "Data Devices": BuiltInCategory.OST_DataDevices,
        "Detail Items": BuiltInCategory.OST_DetailComponents,
        "Doors": BuiltInCategory.OST_Doors,
        "Duct Accessories": BuiltInCategory.OST_DuctAccessory,
        "Duct Fittings": BuiltInCategory.OST_DuctFitting,
        "Duct Insulations": BuiltInCategory.OST_DuctInsulations,
        "Duct Linings": BuiltInCategory.OST_DuctLinings,
        "Duct Placeholders": BuiltInCategory.OST_PlaceHolderDucts,
        "Duct Systems": BuiltInCategory.OST_DuctSystem,
        "Ducts": BuiltInCategory.OST_DuctCurves,
        "Electrical Circuits": BuiltInCategory.OST_ElectricalCircuit,
        "Electrical Equipment": BuiltInCategory.OST_ElectricalEquipment,
        "Electrical Fixtures": BuiltInCategory.OST_ElectricalFixtures,
        "Entourage": BuiltInCategory.OST_Entourage,
        "Fire Alarm Devices": BuiltInCategory.OST_FireAlarmDevices,
        "Flex Ducts": BuiltInCategory.OST_FlexDuctCurves,
        "Flex Pipes": BuiltInCategory.OST_FlexPipeCurves,
        "Floors": BuiltInCategory.OST_Floors,
        "Furniture Systems": BuiltInCategory.OST_FurnitureSystems,
        "Furniture": BuiltInCategory.OST_Furniture,
        "Generic Models": BuiltInCategory.OST_GenericModel,
        "Grids": BuiltInCategory.OST_Grids,
        "HVAC Zones": BuiltInCategory.OST_HVAC_Zones,
        "Levels": BuiltInCategory.OST_Levels,
        "Lighting Devices": BuiltInCategory.OST_LightingDevices,
        "Lighting Fixtures": BuiltInCategory.OST_LightingFixtures,
        "Mass": BuiltInCategory.OST_Mass,
        "Materials": BuiltInCategory.OST_Materials,
        "Mechanical Equipment Sets": BuiltInCategory.OST_MechanicalEquipmentSet,
        "Mechanical Equipment": BuiltInCategory.OST_MechanicalEquipment,
        "MEP Fabrication Containment": BuiltInCategory.OST_FabricationContainment,
        "MEP Fabrication Ductwork": BuiltInCategory.OST_FabricationDuctwork,
        "MEP Fabrication Hangers": BuiltInCategory.OST_FabricationHangers,
        "MEP Fabrication Pipework": BuiltInCategory.OST_FabricationPipework,
        "Model Groups": BuiltInCategory.OST_IOSModelGroups,
        "Nurse Call Devices": BuiltInCategory.OST_NurseCallDevices,
        "Parking": BuiltInCategory.OST_Parking,
        "Parts": BuiltInCategory.OST_Parts,
        "Pipe Accessories": BuiltInCategory.OST_PipeAccessory,
        "Pipe Fittings": BuiltInCategory.OST_PipeFitting,
        "Pipe Insulations": BuiltInCategory.OST_PipeInsulations,
        "Pipe Placeholders": BuiltInCategory.OST_PlaceHolderPipes,
        "Pipes": BuiltInCategory.OST_PipeCurves,
        "Piping Systems": BuiltInCategory.OST_PipingSystem,
        "Planting": BuiltInCategory.OST_Planting,
        "Plumbing Fixtures": BuiltInCategory.OST_PlumbingFixtures,
        "Project Information": BuiltInCategory.OST_ProjectInformation,
        "Railings": BuiltInCategory.OST_StairsRailing,
        "Ramps": BuiltInCategory.OST_Ramps,
        "Rebar Shape": BuiltInCategory.OST_RebarShape,
        "Roads": BuiltInCategory.OST_Roads,
        "Roofs": BuiltInCategory.OST_Roofs,
        "Rooms": BuiltInCategory.OST_Rooms,
        "RVT Links": BuiltInCategory.OST_RvtLinks,
        "Schedules": BuiltInCategory.OST_Schedules,
        "Security Devices": BuiltInCategory.OST_SecurityDevices,
        "Shaft Openings": BuiltInCategory.OST_ShaftOpening,
        "Sheets": BuiltInCategory.OST_Sheets,
        "Site": BuiltInCategory.OST_Site,
        "Spaces": BuiltInCategory.OST_MEPSpaces,
        "Specialty Equipment": BuiltInCategory.OST_SpecialityEquipment,
        "Sprinklers": BuiltInCategory.OST_Sprinklers,
        "Stairs": BuiltInCategory.OST_Stairs,
        "Structural Area Reinforcement": BuiltInCategory.OST_AreaRein,
        "Structural Beam Systems": BuiltInCategory.OST_StructuralFramingSystem,
        "Structural Columns": BuiltInCategory.OST_StructuralColumns,
        "Structural Connections": BuiltInCategory.OST_StructConnections,
        "Structural Fabric Areas": BuiltInCategory.OST_FabricAreas,
        "Structural Fabric Reinforcement": BuiltInCategory.OST_FabricReinforcement,
        "Structural Foundations": BuiltInCategory.OST_StructuralFoundation,
        "Structural Framing": BuiltInCategory.OST_StructuralFraming,
        "Structural Path Reinforcement": BuiltInCategory.OST_PathRein,
        "Structural Rebar Couplers": BuiltInCategory.OST_Coupler,
        "Structural Rebar": BuiltInCategory.OST_Rebar,
        "Structural Stiffeners": BuiltInCategory.OST_StructuralStiffener,
        "Structural Trusses": BuiltInCategory.OST_StructuralTruss,
        "Switch System": BuiltInCategory.OST_SwitchSystem,
        "Telephone Devices": BuiltInCategory.OST_TelephoneDevices,
        "Topography": BuiltInCategory.OST_Topography,
        "Views": BuiltInCategory.OST_Views,
        "Walls": BuiltInCategory.OST_Walls,
        "Windows": BuiltInCategory.OST_Windows,
        "Wires": BuiltInCategory.OST_Wire
    }
    return cat_dict


class CombinedDefinitionIpy():
    def __init__(self, internal_definition=None, binding=None, external_definition=None, xls_definition_values_lst=None):
        # Combined Definition Parameters
        self.combined_definition_name = None
        # [CURRENT] Revit Project Attributes
        self.internal_definition = internal_definition
        if self.internal_definition is not None:
            self.internal_definition_name = internal_definition.Name
            self._parameter_group = internal_definition.ParameterGroup
            self.parameter_group_name = LabelUtils.GetLabelFor(internal_definition.ParameterGroup)
            self.parameter_type = internal_definition.ParameterType
            self.parameter_type_name = internal_definition.ParameterType.ToString()
            self.unit_type = internal_definition.UnitType
            self.unit_type_name = internal_definition.UnitType.ToString()
            self._varies_across_groups = internal_definition.VariesAcrossGroups
            self.varies_across_groups_to_xls = "1" if internal_definition.VariesAcrossGroups else "0"
            self.visible = internal_definition.Visible
        else:
            self.internal_definition = internal_definition
            self.internal_definition_name = None
            self._parameter_group = None
            self.parameter_group_name = None
            self.parameter_type = None
            self.parameter_type_name = None
            self.unit_type = None
            self.unit_type_name = None
            self._varies_across_groups = None
            self.varies_across_groups_to_xls = None
            self.visible = None
        # [CURRENT] Revit Project Binding Attributes
        self.binding = binding
        if self.binding is not None:
            self.binding_type = InstanceBinding if isinstance(binding, InstanceBinding) else TypeBinding
            self.binding_type_bool = None
            self.binding_type_to_xls = "1" if isinstance(binding, InstanceBinding) else "0"
            self.categories_set = binding.Categories
        else:
            self.binding_type = None
            self.binding_type_bool = None
            self.binding_type_to_xls = None
            self.categories_set = None
        # [CURRENT] Revit Shared Parameters Txt File Attributes
        self.sh_parameter = external_definition
        if self.sh_parameter is not None:
            self.sh_parameter_name = external_definition.Name
            self.sh_parameter_guid = external_definition.GUID
            self.sh_parameter_description = external_definition.Description
            self.sh_parameter_discipline = Autodesk.Revit.DB.UnitUtils.GetUnitGroup(external_definition.UnitType)
            self.sh_parameter_discipline_name = Autodesk.Revit.DB.UnitUtils.GetUnitGroup(external_definition.UnitType)
            self.sh_parameter_unit_type = external_definition.ParameterType
            self.sh_parameter_shared_parameter_group_txt = external_definition.OwnerGroup.Name
        else:
            self.sh_parameter_name = None
            self.sh_parameter_guid = None
            self.sh_parameter_description = None
            self.sh_parameter_discipline = None
            self.sh_parameter_discipline_name = None
            self.sh_parameter_unit_type = None
            self.sh_parameter_shared_parameter_group_txt = None
        # [INPUT] From Xls File Parameters Attributes
        self.xls_definition_values_lst = xls_definition_values_lst
        self.xls_parameter_from_xls_id = None  # NO. -> str
        self.internal_definition_name_from_xls = None  # PARAMETER NAME -> str
        self.parameter_discipline_name_from_xls = None   # PARAMETER DISCIPLINE -> str
        self.parameter_type_name_from_xls = None  # TYPE OF PARAMETER -> str
        self.parameter_description_from_xls = None  # TOOLTIP DESCRIPTION  -> str
        self.parameter_shared_parameter_group_from_xls = None  # PARAMETER GROUP -> str
        self.parameter_guid_from_xls = None  # PARAMETER GUID -> str
        self.parameter_group_name_from_xls = None  # GROUP PARAMETER UNDER -> str
        self.binding_type_from_xls_from_xls = None  # 0 - TYPE / 1 - INSTANCE -> str
        self.varies_across_groups_from_xls = None   # 0 - VALUES PER GROUP TYPE / 1 - BY GROUP INSTANCE -> str
        self.categories_set_names_from_xls = None  # CATEGORIES LIST -> str
        # [CURRENT] Categories Set to Create
        if self.xls_definition_values_lst is not None:
            self._categories_set_to_create = self.categories_set_names_from_xls
        else:
            self._categories_set_to_create = None
        # [OUTPUT] To Xls File Parameters Attributes
        if self.internal_definition is not None:
            self.xls_parameter_to_xls_id = self.xls_parameter_from_xls_id   # NO. -> str Need WORK ON THAT !!!!
            self.internal_definition_name_to_xls = self.internal_definition_name # PARAMETER NAME -> str
            self.parameter_discipline_name_to_xls = self.sh_parameter_discipline_name  # PARAMETER DISCIPLINE -> str
            self.parameter_type_name_to_xls = internal_definition.ParameterType.ToString() # TYPE OF PARAMETER -> str
            self.parameter_description_to_xls = self.sh_parameter_description # TOOLTIP DESCRIPTION  -> str
            self.parameter_shared_parameter_group_to_xls = self.sh_parameter_shared_parameter_group_txt # PARAMETER GROUP -> str
            self.parameter_guid_to_xls = self.sh_parameter_guid  # PARAMETER GUID -> str
            self.parameter_group_name_to_xls = LabelUtils.GetLabelFor(internal_definition.ParameterGroup) # GROUP PARAMETER UNDER -> str
            self.binding_type_to_xls_to_xls = self.binding_type_to_xls  # 0 - TYPE / 1 - INSTANCE -> str
            self.varies_across_groups_to_xls = self.varies_across_groups_to_xls    # 0 - VALUES PER GROUP TYPE / 1 - BY GROUP INSTANCE -> str
            self._categories_set_names_to_xls = []  # CATEGORIES LIST -> str
        else:
            self.xls_parameter_to_xls_id = self.xls_parameter_from_xls_id   # NO. -> str
            self.internal_definition_name_to_xls = None  # PARAMETER NAME -> str
            self.parameter_discipline_name_to_xls = None  # PARAMETER DISCIPLINE -> str
            self.parameter_type_name_to_xls = None  # TYPE OF PARAMETER -> str
            self.parameter_description_to_xls = None  # TOOLTIP DESCRIPTION  -> str
            self.parameter_shared_parameter_group_to_xls = None  # PARAMETER GROUP -> str
            self.parameter_guid_to_xls = None  # PARAMETER GUID -> str
            self.parameter_group_name_to_xls = None  # GROUP PARAMETER UNDER -> str
            self.binding_type_to_xls_to_xls = None  # 0 - TYPE / 1 - INSTANCE -> str
            self.varies_across_groups_to_xls = None  # 0 - VALUES PER GROUP TYPE / 1 - BY GROUP INSTANCE -> str
            self._categories_set_names_to_xls = None  # CATEGORIES LIST -> str

    @property
    def categories_set_names_to_xls(self):
        these_cats = []
        for cat in self.categories_set:
            try:
                these_cats.append(cat.Name)
            except SystemError:
                pass
        self._categories_set_names_to_xls = ", ".join(these_cats)
        if self.xls_definition_values_lst[10] == "All":
            self._categories_set_names_to_xls = "All"
        return self._categories_set_names_to_xls

    @staticmethod
    def create_lst_of_categories(input):
        # Get all categories in the document
        all_categories = doc.Settings.Categories
        categories_str_lst = input.lower().title().replace(", ", ",").replace("Rvt", "RVT").replace("Mep", "MEP").replace("Hvac", "HVAC").split(",")
        output_categories_rvt_lst = []
        for str_cat in categories_str_lst:
            # 0-301 Number of All Revit Category
            rvt_category = dict_of_builtin_categories().get(str_cat)
            if rvt_category is not None:
                if str(rvt_category.GetType()) == "IronPython.Runtime.List":
                    pass
                else:
                    rvt_category = uidoc.Document.Settings.Categories.get_Item(rvt_category)
                output_categories_rvt_lst.append(rvt_category)
        return flatten_list(output_categories_rvt_lst)

    @property
    def categories_set_to_create(self):
        return self.create_lst_of_categories(self._categories_set_to_create)

    @staticmethod
    def rvt_group_parameter_under(input_text):
        rvt_parameter_group = dict_of_builtin_pg().get(input_text)
        return rvt_parameter_group

    @property
    # Group  parameter under (In revit project)
    def parameter_group(self):
        return self.rvt_group_parameter_under(self.parameter_group_name_from_xls)

    @property
    def varies_across_groups(self):
        if self.binding_type_from_xls_from_xls == "0":
            self._varies_across_groups = False
            self.varies_across_groups_to_xls = "0"
        if self.varies_across_groups_from_xls == "0":
            self._varies_across_groups = False
            self.varies_across_groups_to_xls = "0"
        if self.varies_across_groups_from_xls == "1":
            self._varies_across_groups = True
            self.varies_across_groups_to_xls = "1"
        return self._varies_across_groups

    def update_combined_definition_name(self):
        input_lst = [self.internal_definition_name, self.sh_parameter_name, self.internal_definition_name_from_xls]
        names_lst = []
        for e in input_lst:
            if e is not None:
                names_lst.append(e)
        name = names_lst[0]
        self.combined_definition_name = name
        return self.combined_definition_name

    def update_revit_project_attrs(self):
        if self.internal_definition is not None:
            self.internal_definition_name = self.internal_definition.Name
            self._parameter_group = self.internal_definition.ParameterGroup
            self.parameter_group_name = LabelUtils.GetLabelFor(self.internal_definition.ParameterGroup)
            self.parameter_type = self.internal_definition.ParameterType
            self.parameter_type_name = self.internal_definition.ParameterType.ToString()
            self.unit_type = self.internal_definition.UnitType
            self.unit_type_name = self.internal_definition.UnitType.ToString()
            self._varies_across_groups = self.internal_definition.VariesAcrossGroups
            self.varies_across_groups_to_xls = "1" if self.internal_definition.VariesAcrossGroups else "0"
            self.visible = self.internal_definition.Visible

    def update_revit_project_binding_attrs(self):
        if self.binding is not None:
            self.binding_type = InstanceBinding if isinstance(self.binding, InstanceBinding) else TypeBinding
            self.binding_type_to_xls = "1" if isinstance(self.binding, InstanceBinding) else "0"
            self.categories_set = self.binding.Categories

    def update_sh_parameter_attrs(self):
        # [UPDATE] Revit Shared Parameters Txt File Attributes
        if self.sh_parameter is not None:
            self.sh_parameter_name = self.sh_parameter.Name  # Name
            self.sh_parameter_guid = self.sh_parameter.GUID  # GUID
            self.sh_parameter_description = self.sh_parameter.Description  # Description
            self.sh_parameter_discipline = Autodesk.Revit.DB.UnitUtils.GetUnitGroup(self.sh_parameter.UnitType)
            self.sh_parameter_discipline_name = Autodesk.Revit.DB.UnitUtils.GetUnitGroup( self.sh_parameter.UnitType)
            self.sh_parameter_unit_type = self.sh_parameter.ParameterType
            self.sh_parameter_shared_parameter_group_txt = self.sh_parameter.OwnerGroup.Name # Shared Parameter Group

    def update_sh_parameter_attrs_by_xls(self):
        if self.xls_definition_values_lst is not None:
            self.sh_parameter_name = self.internal_definition_name_from_xls  # Parameter Name
            self.sh_parameter_description = self.parameter_description_from_xls  # String Description
            self.sh_parameter_unit_type = dict_of_parameter_type().get(self.parameter_type_name_from_xls)
            self.sh_parameter_shared_parameter_group_txt = self.parameter_shared_parameter_group_from_xls  # Shared Parameter GRUP Name
            self._parameter_group = self.rvt_group_parameter_under(self.parameter_group_name_from_xls)
            self._varies_across_groups = self.varies_across_groups
            self.binding_type_bool = False if self.binding_type_from_xls_from_xls == "0" else True
            self._categories_set_to_create = self.categories_set_names_from_xls

    def update_to_xls_parameter_attrs(self):
        if self.internal_definition is not None:
            self.xls_parameter_to_xls_id = self.xls_parameter_from_xls_id  # NO. -> str
            self.internal_definition_name_to_xls = self.internal_definition_name  # PARAMETER NAME -> str
            self.parameter_discipline_name_to_xls = self.sh_parameter_discipline_name  # PARAMETER DISCIPLINE -> str
            self.parameter_type_name_to_xls = self.internal_definition.ParameterType.ToString()  # TYPE OF PARAMETER -> str
            self.parameter_description_to_xls = self.sh_parameter_description  # TOOLTIP DESCRIPTION  -> str
            self.parameter_shared_parameter_group_to_xls = self.sh_parameter_shared_parameter_group_txt  # PARAMETER GROUP -> str
            self.parameter_guid_to_xls = self.sh_parameter_guid  # PARAMETER GUID -> str
            self.parameter_group_name_to_xls = LabelUtils.GetLabelFor(
                self.internal_definition.ParameterGroup)  # GROUP PARAMETER UNDER -> str
            self.binding_type_to_xls_to_xls = self.binding_type_to_xls  # 0 - TYPE / 1 - INSTANCE -> str
            self.varies_across_groups_to_xls = self.varies_across_groups_to_xls  # 0 - VALUES PER GROUP TYPE / 1 - BY GROUP INSTANCE -> str
            self._categories_set_names_to_xls = [cat.Name for cat in self.categories_set]  # CATEGORIES LIST -> str

    def update_from_xls_parameter_attrs(self):
        if self.xls_definition_values_lst is not None:
            self.xls_parameter_from_xls_id = self.xls_definition_values_lst[0]  # NO. -> str
            self.internal_definition_name_from_xls = self.xls_definition_values_lst[1]  # PARAMETER NAME -> str
            self.parameter_discipline_name_from_xls = self.xls_definition_values_lst[2]  # PARAMETER DISCIPLINE -> str
            self.parameter_type_name_from_xls = self.xls_definition_values_lst[3]  # TYPE OF PARAMETER -> str
            self.parameter_description_from_xls = self.xls_definition_values_lst[4]  # TOOLTIP DESCRIPTION -> str
            self.parameter_shared_parameter_group_from_xls = self.xls_definition_values_lst[5]  # PARAMETER GROUP -> str
            self.parameter_guid_from_xls = self.xls_definition_values_lst[6]  # PARAMETER GUID -> str
            self.parameter_group_name_from_xls = self.xls_definition_values_lst[7]  # GROUP PARAMETER UNDER -> str
            self.binding_type_from_xls_from_xls = self.xls_definition_values_lst[8]  # 0 - TYPE / 1 - INSTANCE -> str
            self.varies_across_groups_from_xls = self.xls_definition_values_lst[9]  # 0 - VALUES PER GROUP TYPE / 1 - BY GROUP INSTANCE -> str
            self.categories_set_names_from_xls = self.xls_definition_values_lst[10]  # CATEGORIES LIST -> str
            self.categories_set_names_from_xls = dict_of_all_categories_from_xls(self.xls_definition_values_lst)

    def update_all_attrs(self):
        self.update_combined_definition_name()
        self.update_revit_project_attrs()
        self.update_revit_project_binding_attrs()
        self.update_sh_parameter_attrs()
        self.update_to_xls_parameter_attrs()
        self.update_from_xls_parameter_attrs()

    def get_values_of_the_all_attributes(self):
        revit_project_attrs_lst = [
            self.internal_definition,
            self.internal_definition_name,
            self._parameter_group,
            self.parameter_group_name,
            self.parameter_type,
            self.parameter_type_name,
            self.unit_type,
            self.unit_type_name,
            self.varies_across_groups,
            self.varies_across_groups_to_xls,
            self.visible
        ]
        revit_binding_attrs_lst = [
            self.binding,
            self.binding_type,
            self.binding_type_to_xls,
            self.binding_type_bool,
            self.categories_set,
            self._categories_set_to_create
        ]
        revit_shared_attrs_lst = [
            self.sh_parameter,
            self.sh_parameter_name,  # Parameter Name
            self.sh_parameter_guid,  # GUID code
            self.sh_parameter_description,  # String Description
            self.sh_parameter_discipline,  # Discipline Nmae f. ex. Common -> Revit type
            self.sh_parameter_discipline_name,  # Discipline Nmae f. ex. Common
            self.sh_parameter_unit_type,  # Shared Paramete Unit Type f. ex. Length
            self.sh_parameter_shared_parameter_group_txt  # Shared Parameter GRUP Name
        ]
        xls_from_attrs_lst = [
            self.xls_definition_values_lst,
            self.xls_parameter_from_xls_id,
            self.internal_definition_name_from_xls,
            self.parameter_discipline_name_from_xls,
            self.parameter_type_name_from_xls,
            self.parameter_description_from_xls,
            self.parameter_shared_parameter_group_from_xls,
            self.parameter_guid_from_xls,
            self.parameter_group_name_from_xls,
            self.binding_type_from_xls_from_xls,
            self.varies_across_groups_from_xls,
            self.categories_set_names_from_xls,
        ]
        xls_to_attrs_lst = [
            self.xls_parameter_to_xls_id,
            self.internal_definition_name_to_xls,
            self.parameter_discipline_name_to_xls,
            self.parameter_type_name_to_xls,
            self.parameter_description_to_xls,
            self.parameter_shared_parameter_group_to_xls,
            self.parameter_guid_to_xls,
            self.parameter_group_name_to_xls,
            self.binding_type_to_xls_to_xls,
            self.varies_across_groups_to_xls,
            self._categories_set_names_to_xls
        ]
        all_attr_lst = [
            revit_project_attrs_lst,
            revit_binding_attrs_lst,
            revit_shared_attrs_lst,
            xls_from_attrs_lst,
            xls_to_attrs_lst
        ]
        return all_attr_lst

    def get_values_to_xls_attributes(self):
        return (
            self.xls_parameter_to_xls_id,
            self.internal_definition_name_to_xls,
            self.parameter_discipline_name_to_xls,
            self.parameter_type_name_to_xls,
            self.parameter_description_to_xls,
            self.parameter_shared_parameter_group_to_xls,
            self.parameter_guid_to_xls,
            self.parameter_group_name_to_xls,
            self.binding_type_to_xls_to_xls,
            self.varies_across_groups_to_xls,
            self._categories_set_names_to_xls
        )

    def get_values_from_xls_attributes(self):
        return (
            self.xls_parameter_from_xls_id,
            self.internal_definition_name_from_xls,
            self.parameter_discipline_name_from_xls,
            self.parameter_type_name_from_xls,
            self.parameter_description_from_xls,
            self.parameter_shared_parameter_group_from_xls,
            self.parameter_guid_from_xls,
            self.parameter_group_name_from_xls,
            self.binding_type_from_xls_from_xls,
            self.varies_across_groups_from_xls,
            self.categories_set_names_from_xls
        )


# Get a list of all shared parameter groups and their parameters
def get_existing_shared_parameters_from_txt():
    definition_file = app.OpenSharedParameterFile()
    groups = definition_file.Groups
    existing_shared_parameters_from_txt_lst = []
    for group in groups:
        group_name = group.Name
        shared_parameterss = group.Definitions
        for shared_parameter in shared_parameterss:
            existing_shared_parameter = CombinedDefinitionIpy()
            existing_shared_parameter.sh_parameter = shared_parameter
            existing_shared_parameter.update_sh_parameter_attrs()
            existing_shared_parameter.update_combined_definition_name()
            existing_shared_parameters_from_txt_lst.append(existing_shared_parameter)
    return existing_shared_parameters_from_txt_lst


def create_dataset_of_internal_and_external_definitions_pairs():
    # Take all existing Revit Project Parameters
    internal_and_external_definitions_pairs_lst = []
    iterator = doc.ParameterBindings.ForwardIterator()
    while iterator.MoveNext():
        # Get Internal Definition & Binding
        rvt_internal_definition = iterator.Key  # InternalDefinitions Class
        rvt_binding_class = iterator.Current  # TypeBinding or InstanceBinding Class
        # Get External Definition and Crate tuple with Internal Definition
        definition_file = app.OpenSharedParameterFile()
        groups = definition_file.Groups
        existing_shared_parameters_from_txt_lst = []
        for group in groups:
            group_name = group.Name
            parameters = group.Definitions
            for external_definition in parameters:
                external_definition_name = external_definition.Name
                if external_definition_name == rvt_internal_definition.Name:
                    internal_and_external_definitions_pairs_lst.append(
                        (rvt_internal_definition, rvt_binding_class, external_definition))
    return internal_and_external_definitions_pairs_lst


def get_revit_project_parameters_with_binding():
    # Get Internal and External Definitions Pairs tuples
    internal_and_external_definitions_datasets_lst = create_dataset_of_internal_and_external_definitions_pairs()

    # Create Ipy Objects of existing Revit Project Parameters
    combined_definition_ipy_objects_lst = []
    for element in internal_and_external_definitions_datasets_lst:
        combined_definition = CombinedDefinitionIpy(internal_definition=element[0], binding=element[1],
                                                    external_definition=element[2],
                                                    xls_definition_values_lst=None)
        combined_definition_ipy_objects_lst.append(combined_definition)
    # Add dataset from Xls file to CombinedDefinition Instance
    combined_definition_lst = []
    for combined_definition in combined_definition_ipy_objects_lst:
        for xls_dataset in from_xls_parameters_dataset_lst:
            xls_parameter_name = xls_dataset[1]
            if combined_definition.internal_definition_name == xls_parameter_name:
                combined_definition.xls_definition_values_lst = xls_dataset
                combined_definition.update_from_xls_parameter_attrs()
                combined_definition.update_combined_definition_name()
        combined_definition_lst.append(combined_definition)
    return combined_definition_lst


def get_xls_file_parameters():
    combined_definition_lst = []
    for xls_dataset in from_xls_parameters_dataset_lst:
        combined_definition = CombinedDefinitionIpy()
        combined_definition.xls_definition_values_lst = xls_dataset
        combined_definition.update_from_xls_parameter_attrs()
        combined_definition_lst.append(combined_definition)
    return combined_definition_lst


def list_remove_duplicates_by_combined_parameter_name(joined_lst):
    new_list = []
    for obj in joined_lst:
        obj.update_combined_definition_name()
        if not any(o.combined_definition_name == obj.combined_definition_name for o in new_list):
            new_list.append(obj)
    return new_list


def list_get_duplicates_by_combined_parameter_name(joined_lst):
    new_list = []
    duplicates = []
    for obj in joined_lst:
        obj.update_combined_definition_name()
        if any(o.combined_definition_name == obj.combined_definition_name for o in new_list):
            duplicates.append(obj)
        else:
            new_list.append(obj)
    return duplicates


def test_1(lst):
    lst_len = len(lst)
    error_log = "TEST 1:" + "\n"
    if lst_len == 0:
        error_log += "    - There is no duplicated names in the Xls file."
    else:
        duplicated_names = []
        for e in lst:
            duplicated_names.append(e.combined_definition_name)
        duplicated_names.sort()
        error_log += "   - The Xls file contains shared parameters with duplicated names:" + "\n"
        error_log += '\n'.join(["      - " + str(t) for t in duplicated_names])
    return error_log


def get_unique_objects(list_a, list_b):
    # Get combined definition names of elements in list b
    names_b = []
    for elem in list_b:
        names_b.append(elem.combined_definition_name)
    # Get all elements from a list if they don't exist in list b
    result = []
    for elem in list_a:
        if elem.combined_definition_name not in names_b:
            result.append(elem)
    return result


def get_names(lst):
    result = []
    for e in lst:
        result.append(e.combined_definition_name)
    return result


def test_2(list_a, list_b):
    # Get combined definition names of elements in list b
    names_b = []
    for elem in list_b:
        names_b.append(elem.combined_definition_name)
    # Get all elements from a list if they don't exist in list b
    result_false = []
    result_true = []
    for elem in list_a:
        if elem.combined_definition_name in names_b:
            result_false.append(elem)
        else:
            result_true.append(elem)
    error_log_false = ""
    error_log_true = ""
    if len(result_true) != 0:
        error_log_true = "TEST 2:" + "\n" + "   - The XLS file does not contains shared parameters with names that already exist." + "\n"
        error_log_true += '\n'.join(
            ["      - Parameter " + str(t.combined_definition_name) + " created in the shared parameter txt file." for t
             in result_true])
    if len(result_false) != 0:
        error_log_false = "TEST 2:" + "\n" + "   - The XLS file contains shared parameters with names that already exist." + "\n"
        error_log_false += '\n'.join(
            ["      - Parameter " + str(
                t.combined_definition_name) + " was not created in the shared parameter txt file." for t in
             result_false])
    error_log_2 = '\n'.join([error_log_false, error_log_true])
    return error_log_2


# Create New Shared Parameter and New Group in Shared Parameter from Instance Class
def create_new_group_and_new_parameter(combined_definition_ipy):
    # Get values of attributes
    combined_definition_ipy.update_sh_parameter_attrs_by_xls()
    new_sh_parameter_name = combined_definition_ipy.sh_parameter_name
    new_sh_parameter_type = combined_definition_ipy.sh_parameter_unit_type
    new_sh_parameter_description = combined_definition_ipy.sh_parameter_description
    new_parameter_group_name = combined_definition_ipy.sh_parameter_shared_parameter_group_txt
    # Open Shared Parameters Txt file
    shared_param_file = app.OpenSharedParameterFile()
    new_parameter = Autodesk.Revit.DB.ExternalDefinitionCreationOptions(new_sh_parameter_name, new_sh_parameter_type)
    new_parameter.Description = new_sh_parameter_description
    # Create
    new_group_and_new_parameter = shared_param_file.Groups.Create(new_parameter_group_name).Definitions.Create(
        new_parameter)
    combined_definition_ipy.sh_parameter = new_group_and_new_parameter
    return new_group_and_new_parameter


# Create New Parameter and Add to existing Group in Shared Parameter from Instance Class
def create_new_parameter_and_add_to_existing_group(combined_definition_ipy):
    # Get values of attributes
    combined_definition_ipy.update_sh_parameter_attrs_by_xls()
    new_sh_parameter_name = combined_definition_ipy.sh_parameter_name
    new_sh_parameter_type = combined_definition_ipy.sh_parameter_unit_type
    new_sh_parameter_description = combined_definition_ipy.sh_parameter_description
    new_parameter_group_name = combined_definition_ipy.sh_parameter_shared_parameter_group_txt
    # Open Shared Parameters Txt file
    shared_param_file = app.OpenSharedParameterFile()
    shared_parameter_groups = shared_param_file.Groups
    existing_group = shared_parameter_groups.get_Item(new_parameter_group_name)
    new_parameter = Autodesk.Revit.DB.ExternalDefinitionCreationOptions(new_sh_parameter_name, new_sh_parameter_type)
    new_parameter.Description = new_sh_parameter_description
    # Create
    new_parameter_and_add_to_existing_group = existing_group.Definitions.Create(new_parameter)
    combined_definition_ipy.sh_parameter = new_parameter_and_add_to_existing_group
    return new_parameter_and_add_to_existing_group


# Create New Shared Parameters from List
def create_new_sh_parameters_by_lst_of_instances_of_shared_parameter_ipy(list_of_instances_of_shared_parameter_ipy):
    for shp_instance in list_of_instances_of_shared_parameter_ipy:
        try:
            # Step 5 - Create New Parameters And New Groups
            new_sh_parameter = create_new_group_and_new_parameter(shp_instance)
        except:
            # Step 6 - Create Mew Parameters And Add to Existing Groups
            new_sh_parameter = create_new_parameter_and_add_to_existing_group(shp_instance)
        new_sh_parameter_guid = new_sh_parameter.GUID
        shp_instance.sh_parameter_guid = new_sh_parameter_guid
        shp_instance.parameter_guid_from_xls = new_sh_parameter_guid
        shp_instance.parameter_guid_to_xls = new_sh_parameter_guid
        shp_instance.update_sh_parameter_attrs()
    return list_of_instances_of_shared_parameter_ipy


def update_existing_combined_parameters_lst_by_xls_datasets():
    result = []
    combined_parameters_lst = get_existing_shared_parameters_from_txt()
    combined_parameters_from_xls_file_lst = get_xls_file_parameters()
    for combined_parameter in combined_parameters_lst:
        combined_parameter_name = combined_parameter.sh_parameter_name
        for combined_parameter_xls in combined_parameters_from_xls_file_lst:
            combined_parameter_xls_name = combined_parameter_xls.internal_definition_name_from_xls
            if combined_parameter_name == combined_parameter_xls_name:
                combined_parameter.xls_definition_values_lst = combined_parameter_xls.xls_definition_values_lst
                combined_parameter.update_from_xls_parameter_attrs()
                combined_parameter.update_all_attrs()
                combined_parameter.update_combined_definition_name()
                result.append(combined_parameter)
    return result


def test_3(list_a, list_b):
    # Get combined definition names of elements in list b
    names_b = []
    for elem in list_b:
        names_b.append(elem.combined_definition_name)
    # Get all elements from a list if they don't exist in list b
    result_false = []
    result_true = []
    for elem in list_a:
        if elem.combined_definition_name in names_b:
            result_false.append(elem)
        else:
            result_true.append(elem)
    error_log_false = ""
    error_log_true = ""
    # result_true = result_true.sort(key=lambda x: x.combined_definition_name)
    # result_false = result_false.sort(key=lambda x: x.combined_definition_name)
    if len(result_true) != 0:
        error_log_true = "TEST 3:" + "\n" + "   - The Revit Project does not contains shared parameters with names that already exist." + "\n"
        error_log_true += '\n'.join(
            ["      - Parameter " + str(t.combined_definition_name) + " created in the Revit project." for t
             in result_true])
    if len(result_false) != 0:
        error_log_false = "TEST 3:" + "\n" + "   - The Revit Project contains shared parameters with names that already exist." + "\n"
        error_log_false += '\n'.join(
            ["      - Parameter " + str(
                t.combined_definition_name) + " was not created in the Revit project." for t in
             result_false])
    error_log_3 = '\n'.join([error_log_false, error_log_true])
    return error_log_3


def get_internal_definitions_by_name(name=None):
    selected_internal_parameter = None
    iterator = doc.ParameterBindings.ForwardIterator()
    while iterator.MoveNext():
        object_ipy = CombinedDefinitionIpy(internal_definition=iterator.Key, binding=iterator.Current,
                                           external_definition=None, xls_definition_values_lst=None)
        internal_definition = object_ipy.internal_definition
        internal_definition_name = internal_definition.Name
        if internal_definition_name == name:
            selected_internal_parameter = internal_definition
    return selected_internal_parameter


# REVIT API EXAMPLE
def set_new_parameter_as_instance(new_p_ipy):
    # "https://www.revitapidocs.com/2015/7978cb57-0a48-489e-2c8f-116fa2561437.htm"

    # new_p_ipy_categ_str_lst = new_p_ipy.categories_set_names_from_xls
    # new_p_ipy._categories_set_to_create = new_p_ipy_categ_str_lst

    new_p_ipy.update_from_xls_parameter_attrs()
    # create a category set and insert category of wall to it
    my_categories = app.Create.NewCategorySet()
    # use BuiltInCategory to get category of wall
    parameter_categories_lst = new_p_ipy.categories_set_to_create
    new_p_ipy.update_sh_parameter_attrs_by_xls()
    for my_category in parameter_categories_lst:
        if my_category is not None:
            if my_category.AllowsBoundParameters:
                my_categories.Insert(my_category)
    # Create an instance of InstanceBinding
    instance_binding = app.Create.NewInstanceBinding(my_categories)
    # Get the BindingMap of current document.
    binding_map = uidoc.Document.ParameterBindings
    # Bind the definitions to the document
    try:
        instance_bind_ok = binding_map.Insert(new_p_ipy.sh_parameter, instance_binding, new_p_ipy.parameter_group)
        internal_definition = get_internal_definitions_by_name(new_p_ipy.sh_parameter_name)
        # https://www.revitapidocs.com/2015/9fe3c8c4-9b64-ba8f-5626-730c59417a87.htm
        try:
            internal_definition.SetAllowVaryBetweenGroups(doc, new_p_ipy.varies_across_groups)
            error_log_4 = "   - Parameter " + new_p_ipy.sh_parameter_name + " created in Revit Project."
        except:
            error_log_4 = "   - Parameter " + new_p_ipy.sh_parameter_name + " does not allow to vary value by group instance."
    except:
        instance_bind_ok = False
        error_log_4 = ""
    return instance_bind_ok, error_log_4


def set_new_parameter_as_type(new_p_ipy):
    # https://www.revitapidocs.com/2017/f5066ef5-fa12-4cd2-ad0c-ca72ab21e479.htm

    # new_p_ipy_categ_str_lst = new_p_ipy.categories_set_names_from_xls
    # new_p_ipy._categories_set_to_create = new_p_ipy_categ_str_lst

    new_p_ipy.update_from_xls_parameter_attrs()
    # create a category set and insert category of wall to it
    my_categories = app.Create.NewCategorySet()
    # use BuiltInCategory to get category of wall
    parameter_categories_lst = new_p_ipy.categories_set_to_create
    new_p_ipy.update_sh_parameter_attrs_by_xls()
    for my_category in parameter_categories_lst:
        if my_category is not None:
            if my_category.AllowsBoundParameters:
                my_categories.Insert(my_category)
    # Create an instance of InstanceBinding
    type_binding = app.Create.NewTypeBinding(my_categories)
    # Get the BindingMap of current document.
    binding_map = uidoc.Document.ParameterBindings
    # Bind the definitions to the document
    try:
        type_bind_ok = binding_map.Insert(new_p_ipy.sh_parameter, type_binding,  new_p_ipy.parameter_group)
        error_log_4 = "   - Parameter " + new_p_ipy.sh_parameter_name + " created in Revit Project."
    except:
        type_bind_ok = False
        error_log_4 = "  - Parameter " + new_p_ipy.sh_parameter_name + " does not supported specified Categories."
    return type_bind_ok, error_log_4


def create_new_project_parameters_from_combined_parameters_lst(combined_parameters_lst):
    bind_ok_lst = []
    error_log_4 = ["TEST 4:"]
    for combined_parameter in combined_parameters_lst:
        combined_parameter.update_sh_parameter_attrs_by_xls()
        combined_parameter_bool = combined_parameter.binding_type_bool
        TransactionManager.Instance.EnsureInTransaction(doc)
        if combined_parameter_bool is False:
            # Create New Type Parameter
            new_param_info = set_new_parameter_as_type(combined_parameter)
        if combined_parameter_bool is True:
            # Create New Instance Parameter
            new_param_info = set_new_parameter_as_instance(combined_parameter)
        # set_new_parameter_as_type(shared_parameter_definition, parameter_name)
        TransactionManager.Instance.TransactionTaskDone()
        bind_ok_lst.append(new_param_info[0])
        error_log_4.append(new_param_info[1])
        combined_parameter.update_all_attrs()
    error_log_4 = '\n'.join(error_log_4)
    return combined_parameters_lst, bind_ok_lst, error_log_4


# Step 1 - Get all existing shared parameters from Shared_Parameters.txt
# -> List of IronPython Class' objects
existing_sh_parameters_from_txt_lst = get_existing_shared_parameters_from_txt()

# Step 2 - Get all Revit Project Shared Parameters from Revit Project and Add data from Xls
# -> List of IronPython Class' objects
existing_project_parameters_from_rvt_file_lst = get_revit_project_parameters_with_binding()

# Step 3 - Get all Xls Project Shared Parameters from Xls file
# -> List of IronPython Class' objects
# Step 3.1 - Get Parameters -> List of IronPython Class' objects
existing_project_parameters_from_xls_file_lst = get_xls_file_parameters()
# Step 3.2 - Test 1 - Check if there are duplicated parameter names in xls file -> error_log
existing_project_parameters_duplicates = list_get_duplicates_by_combined_parameter_name(
    existing_project_parameters_from_xls_file_lst)
error_log = test_1(existing_project_parameters_duplicates)
# Step 3.3 - Remove duplicates from list
existing_project_parameters_from_xls_file_lst = list_remove_duplicates_by_combined_parameter_name(
    existing_project_parameters_from_xls_file_lst)

# Step 4 - Compare Xls Parameters with Shared Parameters file and Get Unique Values
# -> List of IronPython Class' objects
unique_parameters_to_create = get_unique_objects(existing_project_parameters_from_xls_file_lst,
                                                 existing_sh_parameters_from_txt_lst)
# Step 4.1 - Test 2 - Check if there are duplicated parameter names in xls and txt file  -> error_log
error_log_2 = test_2(existing_project_parameters_from_xls_file_lst, existing_sh_parameters_from_txt_lst)
# Step 4.2 - Create new shared Parameters # -> List of IronPython Class' objects
new_shared_parameters_from_xls_lst = create_new_sh_parameters_by_lst_of_instances_of_shared_parameter_ipy(
    unique_parameters_to_create)

# Step 5 - New project parameters
# -> List of IronPython Class' objects
updated_sh_parameters_from_txt_lst = update_existing_combined_parameters_lst_by_xls_datasets()
unique_parameters_to_create_in_rvt_project = get_unique_objects(updated_sh_parameters_from_txt_lst,
                                                                existing_project_parameters_from_rvt_file_lst)
# Step 5.1 - Test 3 - Check  if new shared parameter names exist in current project.
error_log_3 = test_3(updated_sh_parameters_from_txt_lst, existing_project_parameters_from_rvt_file_lst)
# Step 5.2 - Create New project parameters
# -> List of IronPython Class' objects
new_param_dataset = create_new_project_parameters_from_combined_parameters_lst(
    unique_parameters_to_create_in_rvt_project)
# Step 5.3 - Test 4 - Feedback about created/uncreated new rvt project parameters
error_log_4 = new_param_dataset[2]
# Step 5.2 - Created New project parameters
# -> List of IronPython Class' objects
new_combined_parameters_lst = new_param_dataset[0]

# Step 6 - Update combined parameters
current_combined_parameters_from_rvt_project = get_revit_project_parameters_with_binding()
output = []
for combined_definition in current_combined_parameters_from_rvt_project:
    combined_definition.update_combined_definition_name()
    combined_definition.update_all_attrs()
    combined_definition.update_from_xls_parameter_attrs()
    try:
        test = combined_definition.xls_definition_values_lst[10]
    except:
        test = False
    if test == "All":
        combined_definition._categories_set_names_to_xls = "All"
    else:
        combined_definition._categories_set_names_to_xls = ", ".join(combined_definition._categories_set_names_to_xls)
    output.append(combined_definition.get_values_to_xls_attributes())

error_summary = '\n'.join([error_log, error_log_2, error_log_3, error_log_4])

OUT = error_summary, output
# ----------------------------------------
code_block_2 = CodeBlock(lst=python_script_2) { lst[1]; lst[0]; }

# group: OUTPUTS
code_block_3 = CodeBlock { 1; 0; false; }
exportExcel = Data.ExportExcel(filePath=output_xls_file, sheetName=python_script, startRow=code_block_3.out0, startCol=code_block_3.out1, data=code_block_2.out0, overWrite=code_block_3.out2)
write_error_log_to_txt = Python(IN[0]=file_from_path_2, IN[1]=code_block_2.out1)
# ---------- write_error_log_to_txt.python (12 lines) ----------
# Enable Python support and load DesignScript library
import clr
clr.AddReference('ProtoGeometry')
from Autodesk.DesignScript.Geometry import *

# The inputs to this node will be stored as a list in the IN variables.
outfile = open(str(IN[0]), "w")
text = IN[1]
outfile.write(text)
outfile.close

OUT = text
# ----------------------------------------
